# Grasshopper definition brep_union.gh (Grasshopper 1.0.7)

brep = Brep([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])
breps = GetGeometry(brep, AtLeast=1, AtMost=2147483647, Filter=1073741840)
sunion = SolidUnion(Breps=breps)

# ---- group: RH_OUT:mesh
mesh = Mesh(sunion)
